# Grasshopper definition auto-color-groups.gh (Grasshopper 1.0.7)
# plug-ins: MetaHopper

# ---- group: Input - Groups
group_names = Panel("""Visual
Display""")
group_color = ColourSwatch(SwatchColor=RGB(255, 0, 255))
# Auto Color Groups
# You can use this template to organize node groups by color coding and keywords.
# Groups are defined by lists of Keywords.
# Every Group has one color.
# Use Keywords as prefixes in node groups naming.
group_names_2 = Panel("Initial data")
group_color_2 = ColourSwatch(SwatchColor=RGB(255, 0, 0))
group_names_3 = Panel("""Text
Info
Instruction
Description""")
group_color_3 = ColourSwatch(SwatchColor=RGB(255, 255, 255))
group_names_4 = Panel("Input")
group_color_4 = ColourSwatch(SwatchColor=RGB(255, 212, 0))
group_names_5 = Panel("""Component
Container""")
group_color_5 = ColourSwatch(SwatchColor=RGB(128, 128, 128))
group_names_6 = Panel("Output")
group_color_6 = ColourSwatch(SwatchColor=RGB(85, 255, 0))
group_color_7 = ColourSwatch(SwatchColor=RGB(255, 255, 255))
group_names_8 = Panel("""Step
Function""")
group_color_8 = ColourSwatch(SwatchColor=RGB(0, 170, 255))

# ---- group: Container
entwine = Entwine(
    Branch00=group_names_2,
    Branch01=group_names_4,
    Branch02=group_names_6,
    Branch03=group_names_8,
    Branch04=group_names,
    Branch05=group_names_3,
    Branch06=group_names_5,
    FlattenInputs=True)
entwine_2 = Entwine(
    Branch00=group_color_2,
    Branch01=group_color_4,
    Branch02=group_color_6,
    Branch03=group_color_8,
    Branch04=group_color,
    Branch05=group_color_3,
    Branch06=group_color_5,
    FlattenInputs=True)

# ---- group: Function - Global Update
# Click the button to Update Colors!
get_groups = GetGroups()  # -> Groups, GroupStyles, Nickname, Color

# ---- group: Function - Select matching groups
text_join = TextJoin(Text=entwine, Join="|")
match_text = MatchText(Text=get_groups.Nickname, RegEx=text_join, Case=False)
dispatch = Dispatch(List=get_groups.Groups, DispatchPattern=match_text)  # -> ListA, ListB

# ---- group: Function - Remove unused colors of empty groups
clean_tree = CleanTree(RemoveNulls=True, RemoveInvalid=True, RemoveEmpty=True, Tree=dispatch.ListA)
param_viewer = ParamViewer(clean_tree)
tree_branch = TreeBranch(Tree=entwine_2, Path=param_viewer, MaintainPaths=True)

# ---- group: Output - Color
set_group_properties = SetGroupProperties(Group=clean_tree, Color=tree_branch)
